% Simulink data dictionary global_data.sldd

Param = Simulink.Parameter([])
ControllerConfiguration = Simulink.ConfigSet(StartTime="0", StopTime="inf", FixedStep="0.1", Solver="FixedStepDiscrete", ProdHWDeviceType="ARM Compatible->ARM Cortex-M", SystemTargetFile="ert.tlc", TargetLang="C")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